# Grasshopper definition Frame.gh (Grasshopper 1.0.7)
# plug-ins: Koala

panel = Panel("""-1;-1
0;0
1;1""")
nonlinearfunction = NonlinearFunction(Name="NLF1", Type=0, PositiveEnd=0, NegativeEnd=0, GrahpPoints=panel)
sections = Panel("""CS1;FORM-1;HEB200;S 235
CS2;FORM-1;HEA200;S 235
CS3;FORM-4;L100X8;S 235
CS4;FORM-4;L80X8;S 235
CS5;FORM-4;L70X5;S 355
CS6;FORM-11;RD20;S 355
CS7;CONC;RECT1200x300;C30/37
CS10;CONC;TSEC1200x300x150x75;C30/37
CS11;CONC;ISEC1200x400x300x200x150x75;C30/37
C12;CONC;LSEC1000x300x100x75;C30/37
C13;CONC;LREV1000x300x100x75;C30/37
C14;TIMB;RECT450x450;C14 (EN 338)
C15;TIMB;CIRC400;C14 (EN 338)
C16;TIMB;ISEC500x45x450x30x600x20;C14 (EN 338)
C17;TIMB;TSEC500x45x450x30;C14 (EN 338)""")
nodesupport = NodeSupport(
    ListOfNodes="BN1",
    Rx=2,
    Ry=2,
    Rz=2,
    Tx=2,
    Ty=2,
    Tz=7,
    StiffnessRx=10,
    StiffnessRy=20,
    StiffnessRz=30,
    StiffnessRx_2=40,
    StiffnessTy=50,
    StiffnessTz=60,
    Angle="Rx10,Ry20,Rz30",
    StiffnessTz_2="NLF1")
panel_2 = Panel(nodesupport)
panel_3 = Panel(nonlinearfunction)
pointsupportonbeam = PointSupportOnBeam(
    ListOfBeams="B3",
    Rx=2,
    Ry=2,
    Rz=2,
    Tx=2,
    Ty=2,
    Tz=7,
    StiffnessRx=10,
    StiffnessRy=20,
    StiffnessRz=30,
    StiffnessTx=40,
    StiffnessTy=50,
    StiffnessTz=60,
    CoordDefinition=0,
    Positionx=0.5,
    Origin=0,
    Repeat=2,
    DeltaX=0.1,
    FunctionTz="NLF1")
beamsupport = BeamSupport(
    ListOfBeams="B1",
    Rx=2,
    Ry=2,
    Rz=2,
    Tx=2,
    Ty=2,
    Tz=7,
    StiffnessRx=10,
    StiffnessRy=20,
    StiffnessRz=30,
    StiffnessTx=40,
    StiffnessTy=50,
    StiffnessTz=60,
    CoordDefinition=0,
    Position1=0.25,
    Position2=0.5,
    Origin=0,
    FunctionTz="NLF1")
pt = Point(Point(4, 0, 4))
pt_2 = Point(Point(4, 0, 0))
panel_4 = Panel(beamsupport)
pt_3 = Point(Point(0, 0, 0))
pt_4 = Point(Point(0, 0, 4))
panel_5 = Panel(pointsupportonbeam)
load_groups = Panel("""LG1; Permanent
LG2; Variable; Standard""")
ln = Line(StartPoint=pt_4, EndPoint=pt)
ln_2 = Line(StartPoint=pt, EndPoint=pt_2)
load_cases = Panel("""LC1; SW; LG1
LC2; Permanent; LG1
LC3; Variable; LG2""")
ln_3 = Line(StartPoint=pt_3, EndPoint=pt_4)
panel_6 = Panel("""CS1
CS10""")
cross_sections = Cross_Sections(Sections=sections)
pointmomentonbeam = PointMomentOnBeam(
    LoadCase="LC2",
    BeamList="B2",
    CoordSys=0,
    Direction=2,
    LoadValue=-1,
    CoordDefinition=0,
    Position=0.5,
    Origin=0,
    Repeat=2,
    DeltaX=0.1)
panel_7 = Panel("""BN2
BN3""")
koalaloadcases_groups = KoalaLoadCases(LoadCases=load_cases, LoadGroups=load_groups)  # -> LoadCases, LoadGroups
beamloads = BeamLoads(
    LoadCase="LC2",
    BeamList="B2",
    CoordSys=0,
    Direction=2,
    Distribution=1,
    LoadValue1=-5,
    LoadValue2=-10,
    CoordDefinition=0,
    Position1=0.25,
    Position2=1,
    Origin=0,
    Ey=0,
    Ez=0)
pointloadonbeam = PointLoadOnBeam(
    LoadCase="LC3",
    BeamList="B2",
    CoordSys=0,
    Direction=2,
    LoadValue="-150",
    CoordDefinition=0,
    Position=0.5,
    Origin=0,
    Repeat="2",
    Ey=0,
    Ez=0,
    DeltaX="0.1")
pointloadonstructnode = PointLoadOnStructNode(LoadCase="LC2", NodeList=panel_7, CoordSys=0, Direction=2, LoadValue="-25", Angle="Rx45,Ry0,Rz0")
pointmomentonstructnode = PointMomentOnStructNode(LoadCase="LC2", NodeList=panel_7, CoordSys=0, Direction=2, LoadValue=-1)
panel_8 = Panel(pointmomentonbeam)
tolerance = Panel("0.0001")
beams = Beams(
    Curves=flatten([ln_3, ln, ln_2]),
    Sections=panel_6,
    Layers="Beams",
    NodePrefix="BN",
    Tolerance=tolerance,
    RemDuplNodes=False,
    StructuralType=0,
    FEMType=0,
    MemberSystemLine=1,
    Ey=0,
    Ez=0,
    BeamNamePrefix="B")  # -> Nodes, Beams
panel_9 = Panel(beams.Beams)
panel_10 = Panel(beams.Nodes)
panel_12 = Panel(pointmomentonstructnode)
average_size_of_2d_curved_elements_m = Panel("0.15")
scale = Panel("1")
list = ValueList({"Concrete", "Steel", "Timber"}, selected=["Concrete", "Steel", "Timber"])
linemomentonbeam = LineMomentOnBeam(
    LoadCase="LC2",
    BeamList="B2",
    CoordSys=0,
    Direction=1,
    Distribution=0,
    LoadValue1=-1,
    LoadValue2=-1,
    CoordDefinition=0,
    Position1=0,
    Position2=1,
    Origin=0)
createxml = CreateXML(
    StructureType=8,
    UILanguage=0,
    Materials=list,
    MeshSize=average_size_of_2d_curved_elements_m,
    Sections=cross_sections,
    Nodes=beams.Nodes,
    Beams=beams.Beams,
    Nodesupports=nodesupport,
    Loadcases=koalaloadcases_groups.LoadCases,
    Loadgroups=koalaloadcases_groups.LoadGroups,
    Lineloads=beamloads,
    FileName="C:\TEMP\Frame.xml",
    Scale=scale,
    RemDuplNodes=False,
    OnDemand=Button(),
    PointloadsonPoints=pointloadonstructnode,
    PointloadsonBeams=pointloadonbeam,
    BeamLineSupports=beamsupport,
    PointSupportsOnBeam=pointsupportonbeam,
    PointMomentsOnNodes=pointmomentonstructnode,
    PointMomentsOnBeams=pointmomentonbeam,
    LineMomentsOnBeams=linemomentonbeam,
    NonlinearFunctions=nonlinearfunction)
path = FilePath("C:\TEMP\TemplateWithInternalForces.esa")
path_2 = FilePath("C:\Program Files (x86)\SCIA\Engineer19.1\ESA_XML.exe")
path_3 = FilePath("C:\TEMP\Template.esa")
analysis = Analysis(
    FileName="C:\TEMP\Frame.xml",
    ESAXMLPath=path_2,
    CalcType=0,
    TemplateName=path,
    OutputFile="C:\TEMP\Koala.xlsx",
    RunESAXML=Button(),
    SavedSEProject=path_3)  # -> Message, OutputFile, SavedSEProject
rec = DataRecorder(createxml, DataLimit=-10, RecordData=True)
panel_13 = Panel(linemomentonbeam)
rec_2 = DataRecorder(analysis.Message, DataLimit=-10, RecordData=True)
panel_14 = Panel(rec)
panel_15 = Panel(rec_2)
